# Grasshopper definition 02_Multiple conditions example.gh (Grasshopper 1.0.7)
# plug-ins: BH.UI.Grasshopper

createtype = CreateType(Component="BH.oM.Structure.Elements.Bar")
randomobject = RandomObject(Type=createtype, Component="{ .RandomObject")
setpropertyvalue = SetPropertyValue(Obj=randomobject, PropName="testKey", Value="777", Component="{ .SetPropertyValue")

number_slider = Slider(0.005, range=0..0.01)
crv = Curve(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)
steelbeam = SteelBeam(
    location=crv,
    height=Slider(0.5, range=0..1),
    width=Slider(0.25, range=0..1),
    webthickness=number_slider,
    flangethickness=number_slider)

number_slider_2 = Slider(0.005, range=0..0.01)
crv_2 = Curve(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)
steelbeam_2 = SteelBeam(
    location=crv_2,
    height=Slider(1, range=0..1),
    width=Slider(0.4, range=0..1),
    webthickness=number_slider_2,
    flangethickness=number_slider_2)

createtype_2 = CreateType(Component="BH.oM.Structure.Elements.Bar")
randomobject_2 = RandomObject(Type=createtype_2, Component="{ .RandomObject")

# ----
# Objects definition
merge = Merge(Data1=setpropertyvalue, Data2=randomobject_2, Data3=steelbeam, Data4=steelbeam_2)
panel = Panel(merge)
objects = Data(merge)

valuecomparisons = ValueComparisons(
    {"LessThan": 0, "LessThanOrEqualTo": 1, "EqualTo": 2, "GreaterThanOrEqualTo": 3, "GreaterThan": 4}, selected="EqualTo",
    Component="BH.oM.Data.ValueComparisons",
    Selection=2)
# Multiple conditions example
# Conditions creation
panel_2 = Panel("testKey")
valuecondition = ValueCondition(PropertyName=panel_2, ReferenceValue="777", Comparison=valuecomparisons, Component="BH.oM.CIH.Conditions.ValueCondition")

createtype_3 = CreateType(Component="BH.oM.Structure.Elements.Bar")
isoftype = IsOfType(Type=createtype_3, Component="BH.oM.CIH.Conditions.IsOfType")

# ----
# Apply conditions
# to the objects
booleanoperator = BooleanOperator(
    {"AND": 0, "OR": 1, "NOT": 2, "XOR": 3, "IMPLIES": 4}, selected="AND",
    Component="BH.oM.Data.BooleanOperator",
    Selection=0)
merge_2 = Merge(Data1=isoftype, Data2=valuecondition)
objects_2 = Data(objects)
verifyconditions = VerifyConditions(Objects=objects_2, Conditions=merge_2, BooleanOperator=booleanoperator, Component="{ .VerifyConditions")
explode = Explode(Object=verifyconditions, Component="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")  # -> Condition, PassedObjects, FailedObjects, FailInfo, Pattern

failedobjects = Panel(explode.FailedObjects)
pattern = Panel(explode.FailInfo)
passedobjects = Panel(explode.PassedObjects)
failinfos_one_per_failed_object = Panel(explode.Pattern)
tostring = ToString(IObj=explode.Condition, Component="{ .ToString")
panel_3 = Panel(tostring)

# ==== cluster SteelBeam
steel = Steel(
    {"S235": 0, "S275": 1, "S355": 2, "S450": 3}, selected="S235",
    Component="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",
    Selection=0)
height = ClusterInput()
width = ClusterInput()
webthickness = ClusterInput()
flangethickness = ClusterInput()
location = ClusterInput()
fabricatedsteelboxsection = FabricatedSteelBoxSection(
    Height=height,
    Width=width,
    WebThickness=webthickness,
    FlangeThickness=flangethickness,
    WeldSize=0,
    Material=steel,
    Component="{ .FabricatedSteelBoxSection")
constantframingproperty = ConstantFramingProperty(SectionProperty=fabricatedsteelboxsection, OrientationAngle=0, Component="{ .ConstantFramingProperty")
beam = Beam(Location=location, Property=constantframingproperty, Component="BH.oM.Physical.Elements.Beam")
B = ClusterOutput(beam)
