# Grasshopper definition 03_Specification example.gh (Grasshopper 1.0.7)
# plug-ins: BH.UI.Grasshopper

# ----
# Define Filter Condition(s)
createtype = CreateType(Component="BH.oM.Physical.Elements.Column")
createtype_2 = CreateType(Component="BH.oM.Structure.Elements.Bar")
isoftype = IsOfType(Type=createtype, Component="BH.oM.CIH.Conditions.IsOfType")
isoftype_2 = IsOfType(Type=createtype_2, Component="BH.oM.CIH.Conditions.IsOfType")
booleanoperator = BooleanOperator(
    {"AND": 0, "OR": 1, "NOT": 2, "XOR": 3, "IMPLIES": 4}, selected="OR",
    Component="BH.oM.Data.BooleanOperator",
    Selection=1)
logicalcondition = LogicalCondition(Conditions=[isoftype_2, isoftype], BooleanOperator=booleanoperator, Component="BH.oM.CIH.Conditions.LogicalCondition")

# ---- group: A Bar with length = 2.5
X = UnitX(Factor=1)
line = LineSDL(Start="0,0,0", Direction=X, Length=Slider(2.5, range=0..10))
bar = Bar(
    Line=line,
    OrientationAngle=0,
    FeaType="{ \"_t\" : \"System.Enum\", \"TypeName\" : { \"_t\" : \"System.Type\", \"Name\" : \"BH.oM.Structure.Elements.BarFEAType\", \"_bhomVersion\" : \"7.0\" }, \"Value\" : \"Flexural\", \"_bhomVersion\" : \"7.0\" }",
    Component="{ .Bar")

# ----
# Define Check Condition(s)
# E.g. make sure that "Length" is between a numeric range.
# If no property called "Length" is found in the objects,
# the TryRunExtensionMethod for a method called "Lenght" is invoked.
number_slider = Slider(3, range=0..3)
domain = Domain(Min=Slider(0.5, range=0..3), Max=number_slider, Component="{ .Domain")
isindomain = IsInDomain(PropertyName="Length", Domain=domain, Tolerance=0, Component="BH.oM.CIH.Conditions.IsInDomain")

# ---- group: A Column with length = 0.3
X_2 = UnitX(Factor=1)
line_2 = LineSDL(Start="0,0,0", Direction=X_2, Length=Slider(0.3, range=0..10))
column = Column(Location=line_2, Component="BH.oM.Physical.Elements.Column")

# ---- group: A Bar with length = 0.4
X_3 = UnitX(Factor=1)
# Verify a set of objects
# against a single Specification
# Create objects
panel = Panel("0,0,0")
line_3 = LineSDL(Start=panel, Direction=X_3, Length=Slider(0.4, range=0..1))
bar_2 = Bar(
    Line=line_3,
    OrientationAngle=0,
    FeaType="{ \"_t\" : \"System.Enum\", \"TypeName\" : { \"_t\" : \"System.Type\", \"Name\" : \"BH.oM.Structure.Elements.BarFEAType\", \"_bhomVersion\" : \"7.0\" }, \"Value\" : \"Flexural\", \"_bhomVersion\" : \"7.0\" }",
    Component="{ .Bar")

# ---- group: A random Node.
createtype_3 = CreateType(Component="BH.oM.Structure.Elements.Node")
randomobject = RandomObject(Type=createtype_3, Component="{ .RandomObject")

# ----
# Define Specification
panel_2 = Panel("Verify that Bars and Columns are shorter than a length.")
example_clause = Panel("Eurocode 1.4.5")
specification = Specification(
    Clause=example_clause,
    SpecName="ElementLength Specification",
    Description=panel_2,
    FilterConditions=logicalcondition,
    CheckConditions=isindomain,
    Component="BH.oM.Data.Specifications.Specification")
tostring = ToString(IObj=specification, Component="{ .ToString")
human_description_of_the_created_specifi = Panel(tostring)  # "Human description of the created Specification"

merge = Merge(Data1=bar_2, Data2=bar, Data3=column, Data4=randomobject)

# ----
# Run the verification
iverifyspecification = IVerifySpecification(Objects=merge, Specification=specification, Component="{ .IVerifySpecification")

# ----
# See the results of the verification
# These are objects that were not assessed by the specification,
# i.e. because they were filtered out by the FilterConditions
explode = Explode(Object=iverifyspecification, Component="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")  # -> Specifications, PassedObjects, FailedObjects, NotAssessedObjects, ObjectFailures
objects_satisfying_the_spec = Panel(explode.PassedObjects)
objects_failing_the_spec = Panel(explode.FailedObjects)
objects_not_considered_by_the_spec = Panel(explode.NotAssessedObjects)

# ----
# Select the single "failure"
number_slider_2 = Slider(0, range=0..1)
item = ListItem(List=explode.ObjectFailures, Index=number_slider_2, Wrap=True)

# ----
# Explore the verification results
tostring_2 = ToString(IObj=explode.Specifications, Component="{ .ToString")

human_description_of_the_verified_specif = Panel(tostring_2)  # "Human description of the verified Specification"

# ----
# See information about the single objects that failed the verification
explode_2 = Explode(Object=item, Component="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")  # -> Object, FailedSpecifications, CheckFailures
explode_3 = Explode(Object=explode_2.CheckFailures, Component="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")  # -> Object, FailedCheckCondition, FailInfo, ParentSpecification
single_object_that_failed_the_spec = Panel(explode_2.Object)
specification_s_that_this_object_failed = Panel(explode_2.FailedSpecifications)
tostring_3 = ToString(IObj=explode_3.FailedCheckCondition, Component="{ .ToString")
reason_why_the_object_failed = Panel(explode_3.FailInfo)
description_of_the_condition_that_failed = Panel(tostring_3)
