# Grasshopper definition 04_Multiple Specifications example.gh (Grasshopper 1.0.7)
# plug-ins: BH.UI.Grasshopper

# ----
# Verify a set of objects
# against multiple Specifications
createtype = CreateType(Component="BH.oM.Structure.Elements.Bar")
randomobject = RandomObject(Type=createtype, Component="{ .RandomObject")
setpropertyvalue = SetPropertyValue(Obj=randomobject, PropName="testKey", Value="777", Component="{ .SetPropertyValue")

number_slider = Slider(0.005, range=0..0.01)
crv = Curve(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)
steelbeam = SteelBeam(
    location=crv,
    height=Slider(0.5, range=0..1),
    width=Slider(0.25, range=0..1),
    webthickness=number_slider,
    flangethickness=number_slider)

number_slider_2 = Slider(0.005, range=0..0.01)
crv_2 = Curve(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)
steelbeam_2 = SteelBeam(
    location=crv_2,
    height=Slider(1, range=0..1),
    width=Slider(0.4, range=0..1),
    webthickness=number_slider_2,
    flangethickness=number_slider_2)

createtype_2 = CreateType(Component="BH.oM.Structure.Elements.Bar")
randomobject_2 = RandomObject(Type=createtype_2, Component="{ .RandomObject")

# ----
# Objects definition
merge = Merge(Data1=setpropertyvalue, Data2=randomobject_2, Data3=steelbeam, Data4=steelbeam_2)
panel = Panel(merge)
objects = Data(merge)

isindomain = IsInDomain(
    PropertyName="Property.Profile.Height",
    Min=Slider(0.3, range=0..1),
    Max=Slider(0.7, range=0..1),
    Tolerance=0.001,
    Component="{ .IsInDomain")

# ----
# IsInSet condition
# check if a property value is among a set of values.
number_slider_3 = Slider(1, range=0..1)
isinset = IsInSet(
    PropertyName="Property.Profile.Width",
    Set=[Slider(0.4, range=0..1), number_slider_3, Slider(0.6, range=0..1)],
    Component="BH.oM.CIH.Conditions.IsInSet")

isindomain_2 = IsInDomain(PropertyName="Property.Profile.Width", Min="-1", Max=Slider(0.2, range=0..1), Tolerance=0.001, Component="{ .IsInDomain")

createtype_3 = CreateType(Component="BH.oM.Physical.Elements.Beam")
isoftype = IsOfType(Type=createtype_3, Component="BH.oM.CIH.Conditions.IsOfType")

booleanoperator = BooleanOperator(
    {"AND": 0, "OR": 1, "NOT": 2, "XOR": 3, "IMPLIES": 4}, selected="OR",
    Component="BH.oM.Data.BooleanOperator",
    Selection=1)
logicalcondition = LogicalCondition(Conditions=[isinset, isindomain_2], BooleanOperator=booleanoperator, Component="BH.oM.CIH.Conditions.LogicalCondition")

specification = Specification(
    SpecName="BeamDepthSpecification",
    FilterConditions=isoftype,
    CheckConditions=logicalcondition,
    Component="BH.oM.Data.Specifications.Specification")

# ----
# Specification 2 definition
beamdepthspecification = Data(specification)

# ----
# BHoM value in domain
number_slider_4 = Slider(1, range=0..1)
domain = Domain(Min=Slider(0, range=0..1), Max=number_slider_4, Component="{ .Domain")
isinrange = IsInRange(Domain=domain, Val=Slider(0, range=0..100), Tolerance=1e-06, Component="{ .IsInRange")
panel_2 = Panel(isinrange)

# ----
# Grasshopper value in domain
number_slider_5 = Slider(0, range=0..100)
dom = ConstructDomain(DomainStart=0, DomainEnd=1)
panel_3 = Panel(dom)
inc = Includes(Value=number_slider_5, Domain=dom)  # -> Includes, Deviation
panel_4 = Panel(inc.Includes)

# ----
# Specification 1 definition
createtype_4 = CreateType(Component="BH.oM.Physical.Elements.Beam")

# ----
# Specification definition
isoftype_2 = IsOfType(Type=createtype_4, Component="BH.oM.CIH.Conditions.IsOfType")

specification_2 = Specification(
    SpecName="BeamHeightSpecification",
    FilterConditions=isoftype_2,
    CheckConditions=isindomain,
    Component="BH.oM.Data.Specifications.Specification")

beamheightspecification = Data(specification_2)

# ----
# Apply multiple specifications
# at the same time
# Use the VerifySpecificationS component
# (with an S at the end)
beamheightspecification_2 = Data(beamheightspecification)
beamdepthspecification_2 = Data(beamdepthspecification)
objects_2 = Data(objects)
merge_2 = Merge(Data1=beamheightspecification_2, Data2=beamdepthspecification_2)
verifyspecifications = VerifySpecifications(
    Objects=objects_2,
    Specifications=merge_2,
    PassRequirement="{ \"_t\" : \"System.Enum\", \"TypeName\" : { \"_t\" : \"System.Type\", \"Name\" : \"BH.oM.Data.PassRequirement\", \"_bhomVersion\" : \"7.0\" }, \"Value\" : \"AllMustPass\", \"_bhomVersion\" : \"7.0\" }",
    Component="{ .VerifySpecifications")

# ----
# See how the objects passed or failed the specs.
explode = Explode(Object=verifyspecifications, Component="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")  # -> Specifications, PassedObjects, FailedObjects, NotAssessedObjects, ObjectFailures
explode_2 = Explode(Object=explode.ObjectFailures, Component="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")  # -> Object, FailedSpecifications, CheckFailures
explode_3 = Explode(Object=explode_2.CheckFailures, Component="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")  # -> Object, FailedCheckCondition, FailInfo, ParentSpecification
tostring = ToString(IObj=explode.Specifications, Component="{ .ToString")
failed_objects = Panel(explode.FailedObjects)
not_assessed_objects = Panel(explode.NotAssessedObjects)
passed_objects = Panel(explode.PassedObjects)
applied_specification = Panel(tostring)
tostring_2 = ToString(IObj=explode_3.ParentSpecification, Component="{ .ToString")
tostring_3 = ToString(IObj=explode_3.FailedCheckCondition, Component="{ .ToString")
failinfos = Panel(explode_3.FailInfo)
failed_checks = Panel(tostring_3)
failed_specifications = Panel(tostring_2)
failed_objects_2 = Panel(explode_2.Object)

# ==== cluster SteelBeam
steel = Steel(
    {"S235": 0, "S275": 1, "S355": 2, "S450": 3}, selected="S235",
    Component="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",
    Selection=0)
height = ClusterInput()
width = ClusterInput()
webthickness = ClusterInput()
flangethickness = ClusterInput()
location = ClusterInput()
fabricatedsteelboxsection = FabricatedSteelBoxSection(
    Height=height,
    Width=width,
    WebThickness=webthickness,
    FlangeThickness=flangethickness,
    WeldSize=0,
    Material=steel,
    Component="{ .FabricatedSteelBoxSection")
constantframingproperty = ConstantFramingProperty(SectionProperty=fabricatedsteelboxsection, OrientationAngle=0, Component="{ .ConstantFramingProperty")
beam = Beam(Location=location, Property=constantframingproperty, Component="BH.oM.Physical.Elements.Beam")
B = ClusterOutput(beam)
