# Grasshopper definition #1-InitialImplementation.gh (Grasshopper 1.0.7)
# plug-ins: BH.UI.Grasshopper

createtype = CreateType(Component="BH.oM.Structure.Elements.Bar")
randomobject = RandomObject(Type=createtype, Component="{ .RandomObject")
setpropertyvalue = SetPropertyValue(Obj=randomobject, PropName="testKey", Value="777", Component="{ .SetPropertyValue")

# ----
# Other test with Custom Object
panel = Panel("newProperty")
createcustom = CreateCustom(NewProperty="abcd", Component="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")
valuecondition = ValueCondition(
    PropertyName=panel,
    ReferenceValue="abcd",
    Comparison="{ \"_t\" : \"System.Enum\", \"TypeName\" : { \"_t\" : \"System.Type\", \"Name\" : \"BH.oM.Data.ValueComparisons\", \"_bhomVersion\" : \"7.0\" }, \"Value\" : \"EqualTo\", \"_bhomVersion\" : \"7.0\" }",
    Component="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")
applyconditions = ApplyConditions(
    Objects=createcustom,
    Conditions=valuecondition,
    BooleanOperator="{ \"_t\" : \"System.Enum\", \"TypeName\" : { \"_t\" : \"System.Type\", \"Name\" : \"BH.oM.Data.BooleanOperator\", \"_bhomVersion\" : \"7.0\" }, \"Value\" : \"AND\", \"_bhomVersion\" : \"7.0\" }",
    Component="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")
explode = Explode(Object=applyconditions, Component="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")  # -> Condition, PassedObjects, FailedObjects, FailInfo, Pattern
tostring = ToString(IObj=explode.Condition, Component="{ .ToString")
passedobjects = Panel(explode.PassedObjects)
failedobjects = Panel(explode.FailedObjects)
failinfos_one_per_failed_object = Panel(explode.FailInfo)
pattern = Panel(explode.Pattern)
panel_2 = Panel(tostring)

number_slider = Slider(0.005, range=0..0.01)
crv = Curve(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)
steelbeam = SteelBeam(
    location=crv,
    height=Slider(0.5, range=0..1),
    width=Slider(0.25, range=0..1),
    webthickness=number_slider,
    flangethickness=number_slider)

number_slider_2 = Slider(0.005, range=0..0.01)
crv_2 = Curve(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)
steelbeam_2 = SteelBeam(
    location=crv_2,
    height=Slider(1, range=0..1),
    width=Slider(0.4, range=0..1),
    webthickness=number_slider_2,
    flangethickness=number_slider_2)

createtype_2 = CreateType(Component="BH.oM.Structure.Elements.Bar")
randomobject_2 = RandomObject(Type=createtype_2, Component="{ .RandomObject")

# ----
# Objects definition
merge = Merge(Data1=setpropertyvalue, Data2=randomobject_2, Data3=steelbeam, Data4=steelbeam_2)
panel_3 = Panel(merge)
objects = Data(merge)

valuecomparisons = ValueComparisons(
    {"LessThan": 0, "LessThanOrEqualTo": 1, "EqualTo": 2, "GreaterThanOrEqualTo": 3, "GreaterThan": 4}, selected="EqualTo",
    Component="BH.oM.Data.ValueComparisons",
    Selection=2)
# Conditions creation
panel_4 = Panel("CustomData[testKey]")
valuecondition_2 = ValueCondition(PropertyName=panel_4, ReferenceValue="777", Comparison=valuecomparisons, Component="BH.oM.CIH.Conditions.ValueCondition")

valuecomparisons_2 = ValueComparisons(
    {"LessThan": 0, "LessThanOrEqualTo": 1, "EqualTo": 2, "GreaterThanOrEqualTo": 3, "GreaterThan": 4}, selected="LessThanOrEqualTo",
    Component="BH.oM.Data.ValueComparisons",
    Selection=1)
valuecondition_3 = ValueCondition(
    PropertyName="Property.Profile.Height",
    ReferenceValue=Slider(0.6, range=0..1),
    Comparison=valuecomparisons_2,
    Component="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")

createtype_3 = CreateType(Component="BH.oM.Structure.Elements.Bar")
isoftype = IsOfType(Type=createtype_3, Component="BH.oM.CIH.Conditions.IsOfType")

createtype_4 = CreateType(Component="BH.oM.Physical.Elements.Beam")
typecondition = TypeCondition(Type=createtype_4, Component="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")

# ----
# Condition example 2
objects_2 = Data(objects)
merge_2 = Merge(Data1=typecondition, Data2=valuecondition_3)
applyconditions_2 = ApplyConditions(
    Objects=objects_2,
    Conditions=merge_2,
    BooleanOperator="{ \"_t\" : \"System.Enum\", \"TypeName\" : { \"_t\" : \"System.Type\", \"Name\" : \"BH.oM.Data.BooleanOperator\", \"_bhomVersion\" : \"7.0\" }, \"Value\" : \"AND\", \"_bhomVersion\" : \"7.0\" }",
    Component="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")
explode_2 = Explode(Object=applyconditions_2, Component="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")  # -> Condition, PassedObjects, FailedObjects, FailInfo, Pattern
failinfos_one_per_failed_object_2 = Panel(explode_2.Pattern)
failedobjects_2 = Panel(explode_2.FailedObjects)
pattern_2 = Panel(explode_2.FailInfo)
passedobjects_2 = Panel(explode_2.PassedObjects)
tostring_2 = ToString(IObj=explode_2.Condition, Component="{ .ToString")
panel_5 = Panel(tostring_2)

# ----
# Condition example 1
# Apply conditions
# to the objects
objects_3 = Data(objects)
merge_3 = Merge(Data1=isoftype, Data2=valuecondition_2)
applyconditions_3 = ApplyConditions(
    Objects=objects_3,
    Conditions=merge_3,
    BooleanOperator="{ \"_t\" : \"System.Enum\", \"TypeName\" : { \"_t\" : \"System.Type\", \"Name\" : \"BH.oM.Data.BooleanOperator\", \"_bhomVersion\" : \"7.0\" }, \"Value\" : \"AND\", \"_bhomVersion\" : \"7.0\" }",
    Component="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")
explode_3 = Explode(Object=applyconditions_3, Component="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")  # -> Condition, PassedObjects, FailedObjects, FailInfo, Pattern
passedobjects_3 = Panel(explode_3.PassedObjects)
failedobjects_3 = Panel(explode_3.FailedObjects)
pattern_3 = Panel(explode_3.FailInfo)
failinfos_one_per_failed_object_3 = Panel(explode_3.Pattern)
tostring_3 = ToString(IObj=explode_3.Condition, Component="{ .ToString")
panel_6 = Panel(tostring_3)

verifyconditions = VerifyConditions(
    Objects=objects_3,
    Conditions=merge_3,
    BooleanOperator="{ \"_t\" : \"System.Enum\", \"TypeName\" : { \"_t\" : \"System.Type\", \"Name\" : \"BH.oM.Data.BooleanOperator\", \"_bhomVersion\" : \"7.0\" }, \"Value\" : \"AND\", \"_bhomVersion\" : \"7.0\" }",
    Component="{ .VerifyConditions")

# ----
# BHoM value in domain
number_slider_3 = Slider(1, range=0..1)
domain = Domain(Min=Slider(0, range=0..1), Max=number_slider_3, Component="{ .Domain")
isinrange = IsInRange(Domain=domain, Val=Slider(0, range=0..100), Tolerance=1e-06, Component="{ .IsInRange")
panel_7 = Panel(isinrange)

# ----
# Grasshopper value in domain
number_slider_4 = Slider(0, range=0..100)
dom = ConstructDomain(DomainStart=0, DomainEnd=1)
panel_8 = Panel(dom)
inc = Includes(Value=number_slider_4, Domain=dom)  # -> Includes, Deviation
panel_9 = Panel(inc.Includes)

domain_2 = Domain(Min=Slider(0.3, range=0..1), Max=Slider(0.7, range=0..1), Component="{ .Domain")
domaincondition = DomainCondition(
    PropertyName="Property.Profile.Height",
    Domain=domain_2,
    Tolerance=0,
    Component="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")

# ----
# Specification2 creation
panel_10 = Panel("Property.Profile.Width")
setcondition = SetCondition(
    PropertyName=panel_10,
    Set=[Slider(0.4, range=0..1), Slider(0.6, range=0..1), Slider(1, range=0..1)],
    Component="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")

domain_3 = Domain(Min="-1", Max=Slider(0.2, range=0..1), Component="{ .Domain")
domaincondition_2 = DomainCondition(PropertyName=panel_10, Domain=domain_3, Tolerance=0, Component="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")

createtype_5 = CreateType(Component="BH.oM.Physical.Elements.Beam")
typecondition_2 = TypeCondition(Type=createtype_5, Component="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")

createtype_6 = CreateType(Component="BH.oM.Physical.Elements.Beam")
typecondition_3 = TypeCondition(Type=createtype_6, Component="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")

# ----
# Specification creation
panel_11 = Panel("BeamHeightSpecification")
specification = Specification(FilterConditions=typecondition_3, CheckConditions=domaincondition, Component="BH.oM.Data.Specifications.Specification")

booleanoperator = BooleanOperator(
    {"AND": 0, "OR": 1, "NOT": 2, "XOR": 3, "IMPLIES": 4}, selected="OR",
    Component="BH.oM.Data.BooleanOperator",
    Selection=1)
logicalcondition = LogicalCondition(
    Conditions=[setcondition, domaincondition_2],
    BooleanOperator=booleanoperator,
    Component="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")

panel_12 = Panel("BeamDepthSpecification")
specification_2 = Specification(FilterConditions=typecondition_2, CheckConditions=logicalcondition, Component="BH.oM.Data.Specifications.Specification")

# ----
# Specification example
# Apply specification
# to the objects
beamheightspecification = Data(specification)
objects_4 = Data(objects)
applyspecification = ApplySpecification(Objects=objects_4, Specification=beamheightspecification, Component="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")
explode_4 = Explode(Object=applyspecification, Component="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")  # -> Specifications, PassedObjects, FailedObjects, NotAssessedObjects, ObjectFailures
failed_objects = Panel(explode_4.FailedObjects)
tostring_4 = ToString(IObj=explode_4.Specifications, Component="{ .ToString")
not_assessed_objects = Panel(explode_4.NotAssessedObjects)
passed_objects = Panel(explode_4.PassedObjects)
applied_specification = Panel(tostring_4)

# ----
# Multiple specifications example
beamheightspecification_2 = Data(beamheightspecification)
objects_5 = Data(objects)
applyspecifications = ApplySpecifications(
    Objects=objects_5,
    Specifications=[beamheightspecification_2, specification_2],
    Component="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")
explode_5 = Explode(Object=applyspecifications, Component="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")  # -> Specifications, PassedObjects, FailedObjects, NotAssessedObjects, ObjectFailures
explode_6 = Explode(Object=explode_5.ObjectFailures, Component="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")  # -> Object, FailedSpecifications, FailInfo
explode_7 = Explode(Object=explode_6.FailInfo, Component="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")  # -> ParentSpecification, FailedCheckCondition, FailInfo
tostring_5 = ToString(IObj=explode_5.Specifications, Component="{ .ToString")
failed_objects_2 = Panel(explode_5.FailedObjects)
not_assessed_objects_2 = Panel(explode_5.NotAssessedObjects)
applied_specification_2 = Panel(tostring_5)
passed_objects_2 = Panel(explode_5.PassedObjects)
tostring_6 = ToString(IObj=explode_7.ParentSpecification, Component="{ .ToString")
tostring_7 = ToString(IObj=explode_7.FailedCheckCondition, Component="{ .ToString")
failinfos = Panel(explode_7.FailInfo)
failed_checks = Panel(tostring_7)
failed_specifications = Panel(tostring_6)
failed_objects_3 = Panel(explode_6.Object)

explode_8 = Explode(Object=explode_4.ObjectFailures, Component="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")  # -> Object, FailedSpecifications, FailInfo
explode_9 = Explode(Object=explode_8.FailInfo, Component="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")  # -> ParentSpecification, FailedCheckCondition, FailInfo
tostring_8 = ToString(IObj=explode_9.FailedCheckCondition, Component="{ .ToString")

failed_checks_2 = Panel(tostring_8)
failinfo = Panel(explode_9.FailInfo)

failed_objects_4 = Panel(explode_8.Object)

# ==== cluster SteelBeam
steel = Steel(
    {"S235": 0, "S275": 1, "S355": 2, "S450": 3}, selected="S235",
    Component="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",
    Selection=0)
height = ClusterInput()
width = ClusterInput()
webthickness = ClusterInput()
flangethickness = ClusterInput()
location = ClusterInput()
fabricatedsteelboxsection = FabricatedSteelBoxSection(
    Height=height,
    Width=width,
    WebThickness=webthickness,
    FlangeThickness=flangethickness,
    WeldSize=0,
    Material=steel,
    Component="{ .FabricatedSteelBoxSection")
constantframingproperty = ConstantFramingProperty(SectionProperty=fabricatedsteelboxsection, OrientationAngle=0, Component="{ .ConstantFramingProperty")
beam = Beam(Location=location, Property=constantframingproperty, Component="BH.oM.Physical.Elements.Beam")
B = ClusterOutput(beam)
